# Grasshopper definition GhPdf_Sample.gh (Grasshopper 1.0.7)
# plug-ins: GhPdf

# ----
# Basic Sample File
# GhPdf | Pdf Interoperability Plugin
# Copyright: 2025 CORE studio | Thornton Tomasetti
# Contact: CORE@ThorntonTomasetti.com
# Website: https://www.aectech.us/
save = BooleanToggle(True)
rec = Rectangle({Plane=PlaneXY(600, 200, 0), Size=Domain2(u=-600..600, v=-200..200)})

c_script = CSharpScript(x="AECtech.png")  # -> out, A; inputs x: String
# ---------- c_script: C# ----------
    var ghDoc = this.Component.OnPingDocument();

    string directoryPath = System.IO.Path.GetDirectoryName(ghDoc.FilePath);

    A = System.IO.Path.Combine(directoryPath, x);
# ---------- end c_script ----------
cluster = Cluster(
    B=rec,
    X=Slider(12, range=0..100),
    Y=Slider(8, range=0..100),
    L=Slider(0.1, range=0..1),
    H=Slider(0.9, range=0..1),
    U=Slider(0.5, range=0..1),
    V=Slider(0.5, range=0..1))  # -> O_2, I_2, A_2
expression = Expression(x=cluster.A_2, Expression="Round(x,2)")
pdf_drawing = DrawingBlock(Curves=flatten([cluster.O_2, cluster.I_2]))
pdf_doc = PdfDocument(Name="GhPdf_Sample", Width=210, Height=297, Units=0)
pdf_text = TextBlock(Text="Hello World", Size=12, Family="Arial", Color=RGB(0, 0, 0))
pdf_table = TableBlock(Values=expression, Size="8", Family="Arial", Color=RGB(0, 0, 0))
pdf_image = ImageBlock(Image=c_script.A)
pdf_set = SetPdfContents(PdfDocument=pdf_doc, Block=flatten([pdf_text, pdf_image, pdf_table, pdf_drawing]))
c_script_2 = CSharpScript(x=save)  # -> out, A, B; inputs x: Boolean
# ---------- c_script_2: C# ----------
    var ghDoc = this.Component.OnPingDocument();

    string directoryPath = System.IO.Path.GetDirectoryName(ghDoc.FilePath);

    A = directoryPath;
    B = x;
# ---------- end c_script_2 ----------
pdf_save = SavePdfDocument(PdfDocument=pdf_set, Directory=c_script_2.A, Activate=c_script_2.B)

# ==== cluster Cluster
L = ClusterInput()
H = ClusterInput()
Y = ClusterInput()
X = ClusterInput()
B = ClusterInput()
U = ClusterInput()
V = ClusterInput()
L_2 = Number(L)
H_2 = Number(H)
U_2 = Number(U)
V_2 = Number(V)
Y_2 = Integer(Y)
X_2 = Integer(X)
B_2 = Rectangle(B)
bbox = BoundingBox(Content=B_2, Plane=PlaneXY(0, 0, 0))  # -> Box, Box_2
dom = ConstructDomain(DomainStart=L_2, DomainEnd=H_2)
debox = DeconstructBox(Box=bbox.Box)  # -> Plane, X, Y, Z
remap = RemapNumbers(Value=U_2, Source=Domain(0, 1), Target=debox.X)  # -> Mapped, Clipped
remap_2 = RemapNumbers(Value=V_2, Source=Domain(0, 1), Target=debox.Y)  # -> Mapped, Clipped
dedomain = DeconstructDomain(Domain=debox.X)  # -> Start, End
dedomain_2 = DeconstructDomain(Domain=debox.Y)  # -> Start, End
vec = VectorXYZ(XComponent=remap.Mapped, YComponent=remap_2.Mapped, ZComponent=0)  # -> Vector, Length
subtraction = Subtraction(A=dedomain.End, B=dedomain.Start)
subtraction_2 = Subtraction(A=dedomain_2.End, B=dedomain_2.Start)
division = Division(A=subtraction, B=X_2)
division_2 = Division(A=subtraction_2, B=Y_2)
recgrid = Rectangular(Plane=PlaneXY(0, 0, 0), SizeX=division, SizeY=division_2, ExtentX=X_2, ExtentY=Y_2)  # -> simplify(Cells), simplify(Points)
area = Area(Geometry=recgrid.Cells)  # -> Area, Centroid
dist = Distance(PointA=vec.Vector, PointB=area.Centroid)
bnd = Bounds(Numbers=flatten(dist))
remap_3 = RemapNumbers(Value=dist, Source=bnd, Target=dom)  # -> simplify(Mapped), Clipped
scale = Scale(Geometry=recgrid.Cells, Center=area.Centroid, Factor=remap_3.Mapped)  # -> Geometry, Transform
area_2 = Area(Geometry=scale.Geometry)  # -> Area, Centroid
subtraction_3 = Subtraction(A=area.Area, B=area_2.Area)
A = Number(subtraction_3)
O = Curve(recgrid.Cells)
I = Curve(scale.Geometry)
A_2 = ClusterOutput(A)
O_2 = ClusterOutput(O)
I_2 = ClusterOutput(I)
